# Grasshopper definition FramedWalls_sine.gh (Grasshopper 1.0.7)
# plug-ins: Pufferfish, CadworkGrasshopper

# ---- group: Create Line
curve_length_mm = Slider(6500, range=0..6500)
X = UnitX(Factor=1)
pt = ConstructPoint(XCoordinate=0, YCoordinate=0, ZCoordinate=0)
line = LineSDL(Start=pt, Direction=X, Length=curve_length_mm)

# ----
divide = DivideCurve(Curve=line, Count=10, Kinks=False)  # -> Points, Tangents, Parameters

# ---- group: SineFunction
sinus_kurven_anzahl = Slider(8, range=0..10)
pi = Pi(Factor=sinus_kurven_anzahl)
multiplication = Multiplication(A=divide.Parameters, B=pi)
sin = Sine(Value=multiplication)
radius = Slider(110, range=0..200)
multiplication_2 = Multiplication(A=sin, B=radius)

# ----
pdecon = Deconstruct(Point=divide.Points)  # -> XComponent, YComponent, ZComponent
pt_2 = ConstructPoint(XCoordinate=pdecon.XComponent, YCoordinate=multiplication_2, ZCoordinate=pdecon.YComponent)

wall_thickness = Slider(260, range=0..1000)
intcrv = Interpolate(Vertices=pt_2, Degree=3, Periodic=False, KnotStyle=1)  # -> Curve, Length, Domain
offcrv = OffsetCurve(Curve=intcrv.Curve, Plane=PlaneXY(0, 0, 0), Distance=wall_thickness, BothSides=0, Kinks=0, CapType=1)
explode = Explode(Curve=offcrv, Recursive=True)  # -> Segments, Vertices
wall_height = Slider(2600, range=0..10000)
item = ListItem(List=explode.Segments, Index=0, Wrap=True)  # -> simplify(Item), Item1, Item2, Item3
edgesrf = EdgeSurface(CurveA=item.Item, CurveB=item.Item1, CurveC=item.Item2, CurveD=item.Item3)
Z = UnitZ(Factor=wall_height)
extr = Extrude(Base=edgesrf, Direction=Z)
hüllkörper = Brep(flatten(extr))

# ---- group: find lateral surface
debrep = DeconstructBrep(Brep=hüllkörper)  # -> Faces, Edges, Vertices
area = Area(Geometry=debrep.Faces)  # -> Area, Centroid
sort = SortList(Keys=area.Area, ValuesA=debrep.Faces)  # -> Keys, reverse(ValuesA)
item_2 = ListItem(List=sort.ValuesA, Index=0, Wrap=True)

# ---- group: find longest edge
debrep_2 = DeconstructBrep(Brep=item_2)  # -> Faces, Edges, Vertices
len = Length(Curve=debrep_2.Edges)
sort_2 = SortList(Keys=len, ValuesA=debrep_2.Edges)  # -> Keys, reverse(ValuesA)
item_3 = ListItem(List=sort_2.ValuesA, Index=0, Wrap=True)  # -> Item, Item1

# ----
sprungmass = Slider(625, range=0..1000)
stud_width = Slider(60, range=0..100)

len_2 = Length(Curve=debrep.Edges)
sort_3 = SortList(Keys=len_2)  # -> Keys, ValuesA
item_4 = ListItem(List=sort_3.Keys, Index=0, Wrap=True)
wallthickness = Panel(item_4)
item_5 = ListItem(List=sort_2.Keys, Index=0, Wrap=True)
heigth = Panel(item_5)
expression = Expression(x=wallthickness, Expression="-x")

expression_2 = Expression(x=stud_width, Expression="- x/2.0")
expression_3 = Expression(x=stud_width, Expression="x/2.0")
ext = ExtendCurve(Curve=simplify(item_3.Item), Type=0, Start=expression_2, End=expression_2)
divdist = DivideDistance(Curve=simplify(ext), Distance=sprungmass)  # -> Points, Tangents, Parameters
end = EndPoints(Curve=ext)  # -> Start, End
lng = ListLength(List=divdist.Points)
ins = InsertItems(List=divdist.Points, Item=end.End, Indices=lng, Wrap=True)
crv_cp = CurveClosestPoint(Point=ins, Curve=ext)  # -> Point, Parameter, Distance
dom = ConstructDomain(DomainStart=expression_2, DomainEnd=expression_3)
brep_cp = BrepClosestPoint(Point=ins, Brep=item_2)  # -> Point, Normal, Distance
plate_thickness = Slider(27, range=0..1000)
eval = EvaluateCurve(Curve=ext, Parameter=crv_cp.Parameter)  # -> Point, Tangent, Angle
evalsrf = EvaluateSurface(Surface=item_2, Point=Point(0.5, 0.5, 0))  # -> Point, Normal, UDirection, VDirection, Frame
xprod = CrossProduct(VectorA=brep_cp.Normal, VectorB=eval.Tangent, Unitize=False)  # -> Vector, Length
pl = ConstructPlane(Origin=eval.Point, XAxis=eval.Tangent, YAxis=brep_cp.Normal)
multiplication_3 = Multiplication(A=evalsrf.VDirection, B=plate_thickness)
rectangle = Rectangle(Plane=pl, XSize=dom, YSize=expression, Radius=0)  # -> Rectangle, Length
multiplication_4 = Multiplication(A=xprod.Vector, B=heigth)
extr_2 = Extrude(Base=item_2, Direction=multiplication_3)
extr_3 = Extrude(Base=rectangle.Rectangle, Direction=multiplication_4)
brep = Brep(extr_3)
cap = CapHoles(Brep=brep)

# ---- group: wall & member
int = Integer(97)
cw_std_attr = StdAttr(Material="C24", Ifc_Element_Type="IfcMember")
cw_std_attr_2 = StdAttr(Material="Hüllen", Color=int, Ifc_Element_Type="IfcWall")
cw_attr = CwAttr(Name="Stud", Group="FramedWall", Subgroup="Inner wall")
cw_architecwall = ArchitecWall(Geom=flatten(hüllkörper), CwAttr=cw_attr, StdAttr=cw_std_attr_2)
cw_beam = Beam(Geom=flatten(cap), CwAttr=cw_attr, StdAttr=cw_std_attr)

# ---- group: Plate
cw_std_attr_3 = StdAttr(Material="DWD", Color=Slider(16, range=0..100), Ifc_Element_Type="IfcMember")
cw_attr_2 = CwAttr(Name="Plate", Group="FramedWall", Subgroup="Inner wall")
cw_panel = Panel(Geom=flatten(extr_2), CwAttr=cw_attr_2, StdAttr=cw_std_attr_3)
