# Grasshopper definition example_1.gh (Grasshopper 1.0.7)
# plug-ins: CadworkGrasshopper

member_height = Slider(120, range=0..1000)
stud_height = Slider(240, range=0..1000)
stud_distance = Slider(625, range=0..1000)
stud_count = Slider(10, range=0..10)
stud_width = Slider(60, range=0..100)
stud_length = Slider(2450, range=0..10000)
# Param Inputs
construct_plane = ConstructPlane(Origin=Point(0, 0, 0), XAxis=Vector(1, 0, 0), YAxis=Vector(0, 1, 0))

unit_z = UnitZ(Factor=stud_length)
rectangle = Rectangle(Plane=construct_plane, XSize=stud_width, YSize=stud_height, Radius=0)  # -> Rectangle, Length
series = Series(Start=0, Step=stud_distance, Count=stud_count)
# Stud
extrude = Extrude(Base=rectangle.Rectangle, Direction=unit_z)
unit_x = UnitX(Factor=series)
cap_holes = CapHoles(Brep=extrude)
move = Move(Geometry=cap_holes, Motion=unit_x)  # -> Geometry, Transform

deconstruct_brep = DeconstructBrep(Brep=move.Geometry)  # -> flatten(Faces), Edges, flatten(Vertices)
list_item = ListItem(List=move.Geometry, Index=0, Wrap=True)  # -> Item1, Item
deconstruct_brep_2 = DeconstructBrep(Brep=[list_item.Item1, list_item.Item])  # -> Faces, Edges, flatten(Vertices)
area = Area(Geometry=deconstruct_brep.Faces)  # -> Area, Centroid
deconstruct = Deconstruct(Point=area.Centroid)  # -> XComponent, YComponent, ZComponent
# Drilling Points
sort_list = SortList(Keys=deconstruct.ZComponent, ValuesValuesA=deconstruct_brep.Faces)  # -> Keys, ValuesValuesA
unit_z_2 = UnitZ(Factor=member_height)
list_item_2 = ListItem(List=sort_list.Keys, Index=0, Wrap=True)  # -> Item1, Item
point = Point(area.Centroid)
ghpython_script = GhPythonScript(x=list_item_2.Item1, points=point)  # -> out, a; inputs points: Point3d
# ---------- ghpython_script: Python ----------
__author__ = "admin"
__version__ = "2021.09.16"

import rhinoscriptsyntax as rs

top_face = []

for p in [points]:
    if p.Z == x:
        top_face.append(p)
    else: continue

a = top_face
# ---------- end ghpython_script ----------
move_2 = Move(Geometry=ghpython_script.a, Motion=unit_z_2)  # -> Geometry, Transform
clean_tree = CleanTree(RemoveNulls=True, RemoveInvalid=True, RemoveEmpty=False, Tree=move_2.Geometry)

deconstruct_2 = Deconstruct(Point=deconstruct_brep_2.Vertices)  # -> XComponent, YComponent, ZComponent
sort_list_2 = SortList(Keys=deconstruct_2.ZComponent, ValuesValuesA=deconstruct_brep_2.Vertices)  # -> Keys, ValuesValuesA

yz_plane = YZPlane(Origin=unit_z)
list_length = ListLength(List=sort_list_2.ValuesValuesA)  # -> expr("x *0.5", Length)
rectangle_2 = Rectangle(Plane=yz_plane, XSize=stud_height, YSize=member_height, Radius=0)  # -> Rectangle, Length
range = Range(Domain=list_length, Steps=list_length)
cull_index = CullIndex(List=sort_list_2.ValuesValuesA, Indices=range, Wrap=True)
deconstruct_3 = Deconstruct(Point=cull_index)  # -> XComponent, YComponent, ZComponent
# Member
sort_list_3 = SortList(Keys=deconstruct_3.XComponent, ValuesValuesA=cull_index)  # -> Keys, ValuesValuesA
list_item_3 = ListItem(List=sort_list_3.ValuesValuesA, Index=0, Wrap=True)  # -> Item1, Item
list_item_4 = ListItem(List=[list_item_3.Item, list_item_3.Item1], Index=0, Wrap=True)  # -> Item1, Item
distance = Distance(PointA=list_item_3.Item1, PointB=list_item_3.Item)
vector_2pt = Vector2Pt(PointA=list_item_4.Item, PointB=list_item_4.Item1, Unitize=True)  # -> Vector, Length
multiplication = Multiplication(A=vector_2pt.Vector, B=distance)
extrude_2 = Extrude(Base=rectangle_2.Rectangle, Direction=multiplication)

# ----
# Point 1
# Point 2
# IfcBuilding / IfcStorey
panel = Panel("GH-Building")
# Cadwork Elements
point_2 = Point(clean_tree)
point_3 = Point(ghpython_script.a)
geometry = Geometry(move.Geometry)
geometry_2 = Geometry(extrude_2)

stdattr = StdAttr(Color=Slider(2, range=0..10), BIMBuilding=panel, BIMStorey="GH-Storey", IfcElementType="IfcMechanicalFastener")
cwattr = CwAttr(Name="Drilling", Subgroup="Frame")
drilling = Drilling(Point_1=flatten(point_2), Point_2=flatten(point_3), Diameter=Slider(6, range=0..10), CwAttr=cwattr, StdAttr=stdattr)

unit_z_3 = UnitZ(Factor=1)
unit_y = UnitY(Factor=1)
stdattr_2 = StdAttr(Color=Slider(8, range=0..10), BIMBuilding=panel, BIMStorey="GH-Storey", IfcElementType="IfcMember")
axis = Axis(VectorXLocal=unit_z_3, VectorZLocal=unit_y)  # -> OutputAxis, VectorXLocal, VectorZLocal
cwattr_2 = CwAttr(Name="Stud", Subgroup="Frame")
beam = Beam(Geom=flatten(geometry), Axis=axis.OutputAxis, CwAttr=cwattr_2, StdAttr=stdattr_2)

stdattr_3 = StdAttr(Color=Slider(5, range=0..10), BIMBuilding=panel, BIMStorey="GH-Storey", IfcElementType="IfcMember")
cwattr_3 = CwAttr(Name="Member", Subgroup="Frame")
beam_2 = Beam(Geom=flatten(geometry_2), CwAttr=cwattr_3, StdAttr=stdattr_3)
