# Grasshopper definition example_facade.gh (Grasshopper 1.0.7)
# plug-ins: CadworkGrasshopper

# Thanks to Ursula Frick
# from Blumer Lehmann AG for this Example
number_slider = Slider(80, range=0..1000)
crv = Curve(flatten([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]))
crv_2 = Curve(graft([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]))
crv_3 = Curve(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)
boundary = BoundarySurfaces(Edges=crv)
X = UnitX(Factor=Slider(42, range=0..100))
pframes = PerpFrames(Curve=crv_3, Count=number_slider, Align=True)  # -> Frames, Parameters
X_2 = UnitX(Factor=Slider(42, range=0..100))
pcx = CurvePlane(Curve=crv_2, Plane=pframes.Frames)  # -> simplify(Points), ParamsC, ParamsP
path_mapper = PathMapper(pcx.Points, source="{A;B}", target="{A}")
flip = FlipMatrix(Data=path_mapper)
pline = PolyLine(Vertices=flip, Closed=True)
boundary_2 = BoundarySurfaces(Edges=pline)
extr = Extrude(Base=boundary, Direction=X_2)
extr_2 = Extrude(Base=boundary_2, Direction=X)
sdiff = SolidDifference(BrepsA=extr_2, BrepsB=flatten(extr))

cw_std_attr = StdAttr(
    Material="Eiche",
    Color=Slider(42, range=0..42),
    BIM_Building="Grasshopper_Building",
    BIM_Storey="Grasshopper_Storey",
    Ifc_Element_Type="IfcMember")
cw_attr = CwAttr(Name="Fassadenbalken", Group="Fassade", Subgroup="Fassade_Süd", User199Keys="cw_FireRating", User199Values="R30")
cw_panel = Panel(Geom=flatten(sdiff), CwAttr=cw_attr, StdAttr=cw_std_attr)
