# Grasshopper definition example_plates.gh (Grasshopper 1.0.7)
# plug-ins: CadworkGrasshopper

selectelements = SelectElements(
    cwAttributes="[\"cw_name: Platte\",\"cw_name: Platte\",\"cw_name: Platte\",\"cw_name: Platte\"]",
    cwAxisXx=[0, 0, 0, 0],
    cwAxisXy=[1, 1, 1, 1],
    cwAxisXz=[0, 0, 0, 0],
    cwAxisZx=[0, 0, 0, 0],
    cwAxisZy=[0, 0, 0, 0],
    cwAxisZz=[1, 1, 1, 1],
    cwBreps="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",
    cwStdAttributes="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")  # -> OutputBrep, VectorXLocal, VectorZLocal, OutputCwAttributesKeys, OutputCwAttributesValues, OutputStdAttributesKeys, OutputStdAttributesValues
selectbrep = SelectBrep(cwBreps="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")
selectbrep_2 = SelectBrep(cwBreps="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")
expression = Expression(Expression="-1")  # disabled
shift_list = ShiftList(List=flatten(selectbrep_2), Shift=0, Wrap=True)  # disabled

# ----
# Get Contact Face/Curve
expression_2 = Expression(Expression="-1")
shift_list_2 = ShiftList(List=flatten(selectelements.OutputBrep), Shift=0, Wrap=True)
shift_list_3 = ShiftList(List=flatten(selectelements.OutputBrep), Shift=expression_2, Wrap=True)
brep_brep = BrepBrep(BrepA=shift_list_3, BrepB=shift_list_2)  # -> flatten(Curves), Points

shift_list_4 = ShiftList(List=flatten(selectbrep_2), Shift=expression, Wrap=True)  # disabled
ghpython_script = GhPythonScript(x=shift_list_4, y=shift_list)  # -> simplify(out), a; inputs x: Brep, y: Brep; disabled
# ---------- ghpython_script: Python ----------
__author__ = "admin"
__version__ = "2021.10.18"

import rhinoscriptsyntax as rs
print(x,y)
if rs.IntersectBreps(x,y, 0.0001):
    a = x,y
    out = bool(a)
# ---------- end ghpython_script ----------
panel = Panel(ghpython_script.a)  # disabled
explode = Explode(Curve=brep_brep.Curves, Recursive=True)  # -> Segments, Vertices
geometry = Geometry(ghpython_script.a)  # disabled

point = Point(explode.Vertices)
deconstruct = Deconstruct(Point=point)  # -> XComponent, YComponent, ZComponent
sort_list = SortList(Keys=deconstruct.ZComponent, ValuesValuesA=point)  # -> Keys, ValuesValuesA
cull_duplicates = CullDuplicates(Points=sort_list.ValuesValuesA, Tolerance=0.1, CullMode=3)  # -> Points, Indices, Valence

data = Data(selectelements.VectorZLocal)
data_2 = Data(selectelements.VectorXLocal)
selectbrep_3 = SelectBrep(cwBreps="[null]")

list_item = ListItem(List=cull_duplicates.Points, Index=0, Wrap=True)  # -> Item2, Item1, Item
vector_2pt = Vector2Pt(PointA=list_item.Item2, PointB=list_item.Item1, Unitize=False)  # -> Vector, Length

point_2 = Point(list_item.Item2)
cross_product = CrossProduct(VectorA=data_2, VectorB=data, Unitize=False)  # -> Vector, Length
axis = Axis()
construct_plane = ConstructPlane(Origin=list_item.Item2, XAxis=cross_product.Vector, YAxis=data)
panel_2 = Panel(vector_2pt.Vector)
unit_vector = UnitVector(Vector=panel_2)
panel_3 = Panel(axis)
panel_4 = Panel(unit_vector)

number_slider = Slider(260, range=0..1000)
number_slider_2 = Slider(27, range=0..100)
construct_domain = ConstructDomain(DomainStart=expr("x * 0.5", number_slider), DomainEnd=expr("x * -0.5", number_slider))
expression_3 = Expression(x=number_slider_2, Expression="x * -1")
rectangle = Rectangle(Plane=construct_plane, XSize=construct_domain, YSize=expression_3, Radius=0)  # -> Rectangle, Length
multiplication = Multiplication(A=unit_vector, B=vector_2pt.Length)
extrude = Extrude(Base=rectangle.Rectangle, Direction=multiplication)
cap_holes = CapHoles(Brep=extrude)  # -> flatten(Brep)

number_slider_3 = Slider(280, range=0..1000)
construct_domain_2 = ConstructDomain(DomainStart=expr("x * 0.5", number_slider_3), DomainEnd=expr("x * -0.5", number_slider_3))
deconstruct_plane = DeconstructPlane(Plane=construct_plane)  # -> Origin, XAxis, YAxis, ZAxis
expression_4 = Expression(x=Slider(27, range=0..100), Expression="x * -1")
multiplication_2 = Multiplication(A=deconstruct_plane.XAxis, B=Slider(50, range=0..100))
plane = Plane(construct_plane)
rectangle_2 = Rectangle(Plane=construct_plane, XSize=construct_domain_2, YSize=expression_4, Radius=0)  # -> Rectangle, Length
move = Move(Geometry=plane, Motion=expr("x * -1", multiplication_2))  # -> Geometry, Transform
move_2 = Move(Geometry=plane, Motion=multiplication_2)  # -> Geometry, Transform
extrude_2 = Extrude(Base=rectangle_2.Rectangle, Direction=multiplication)
number_slider_4 = Slider(-100, range=-100..100)

list_length = ListLength(List=cap_holes)
series = Series(Start=0, Step=1, Count=list_length)
repeat_data = RepeatData(Data="Lasche_", Length=list_length)
concatenate = Concatenate(FragmentA=repeat_data, FragmentB=series)
panel_5 = Panel(concatenate)

line_sdl = LineSDL(Start=[move.Geometry, move_2.Geometry], Direction=unit_vector, Length=vector_2pt.Length)
cap_holes_2 = CapHoles(Brep=extrude_2)  # -> flatten(Brep)
extend_curve = ExtendCurve(Curve=line_sdl, Type=0, Start=number_slider_4, End=number_slider_4)

list_length_2 = ListLength(List=cap_holes_2)
series_2 = Series(Start=0, Step=1, Count=list_length_2)
repeat_data_2 = RepeatData(Data="Schneidekörper_", Length=list_length_2)
concatenate_2 = Concatenate(FragmentA=repeat_data_2, FragmentB=series_2)
panel_6 = Panel(concatenate_2)

divide_distance = DivideDistance(Curve=extend_curve, Distance=Slider(250, range=0..1000))  # -> Points, Tangents, Parameters
multiplication_3 = Multiplication(A=number_slider_2, B=data)
move_3 = Move(Geometry=divide_distance.Points, Motion=expr("x * -1", multiplication_3))  # -> Geometry, Transform
drilling = Drilling(Point_1=flatten(divide_distance.Points), Point_2=flatten(move_3.Geometry), Diameter=Slider(5, range=0..10))
stdattr = StdAttr(Color=Slider(12, range=0..12), IfcElementType="IfcPlate")
cwattr = CwAttr(Name=concatenate, User199=flatten(["01: Hallo", "02: Welt"]))
axis_2 = Axis(VectorXLocal=data_2, VectorZLocal=data)  # -> flatten(OutputAxis)
stdattr_2 = StdAttr(Color=Slider(2, range=0..12))
cwattr_2 = CwAttr(Name=concatenate_2, User199=flatten(["01: Hallo", "02: Welt"]))
axis_3 = Axis(VectorXLocal=data_2, VectorZLocal=data)  # -> flatten(OutputAxis)
panel_7 = Panel(Geom=cap_holes, Axis=axis_2, CwAttr=cwattr, StdAttr=stdattr)
auxvol = AuxVol(Geom=cap_holes_2, CwAttr=cwattr_2, StdAttr=stdattr_2)
