# Grasshopper definition undulating_surface.gh (Grasshopper 1.0.7)
# plug-ins: CadworkGrasshopper

number_slider = Slider(11, range=0..20)
number_slider_2 = Slider(400, range=0..1000)
sqgrid = Square(Plane=PlaneXY(0, 0, 0), Size=Slider(500, range=0..1000), ExtentX=number_slider, ExtentY=number_slider)  # -> Cells, Points
construct_domain = ConstructDomain(DomainStart=expr("-x", number_slider_2), DomainEnd=number_slider_2)
lng = ListLength(List=flatten(sqgrid.Points))
random = Random(Range=construct_domain, Number=expr("x-1", lng), Seed=2)
pt = Point(sqgrid.Points)
Z = UnitZ(Factor=random)
move = Move(Geometry=graft(pt), Motion=graft(Z))  # -> Geometry, Transform
srfgrid = SurfaceFromPoints(Points=flatten(move.Geometry), UCount=expr("x+1", number_slider), Interpolate=False)
surface = Surface(Geom=flatten(srfgrid))
